# Grasshopper definition M6U1&U2_Group Assignment.gh (Grasshopper 1.0.8)
# plug-ins: Rhino.Inside for Autodesk Revit

floor_height = Slider(4, range=3..5)
col_spacing = Slider(6, range=4..10)
num_floors = Slider(10, range=5..50)
setback = Slider(30, range=2.4..30)
default_plot_200x200 = Rectangle(Plane=PlaneXY(0, 0, 0), XSize=Domain(0, 200), YSize=Domain(0, 200), Radius=0)  # -> Rectangle, Length
unit_z = UnitZ(Factor=1)
plot_boundary = Curve(default_plot_200x200.Rectangle)
plot_area = Area(Geometry=plot_boundary)  # -> Area, Centroid
categories = QueryCategories(Type=1, Name="Floors", IsVisibleUI=True, IsSubcategory=False)
floor_elevations = Series(Start=0, Step=floor_height, Count=num_floors)
Z = UnitZ(Factor=floor_elevations)
concat = Concatenate(FragmentA="Total Floors: 0", FragmentB=num_floors)
total_height = Multiplication(A=num_floors, B=floor_height)
types = QueryTypes(Kind=3, Category=categories)
glass_material = CreateMaterial(Diffuse=RGBA(0, 0, 0, 0), Specular=RGB(255, 255, 255), Emission=RGB(0, 0, 0), Transparency=0.7, Shine=0)
amplitude = Amplitude(Vector=unit_z, Amplitude=total_height)
item = ListItem(List=types, Index=0, Wrap=True)
indices = Series(Start=1, Step=1, Count=10)
level_names = Format(Format="L{0:00}", Culture=127, Data0=indices)
add_level = AddLevel(Elevation=floor_elevations, Name=level_names, TrackingMode=2)
concrete_swatch = ColourSwatch(SwatchColor=RGB(204, 204, 204))
_60_plot_area = Multiplication(A=plot_area.Area, B=0.6)
top_vector = UnitZ(Factor=total_height)
inward_offset = Negative(Value=setback)
concat_2 = Concatenate(FragmentA=concat, FragmentB="Total Floor Area: 0")
item_2 = ListItem(List=add_level, Index=-1, Wrap=True)
footprint_offset = OffsetCurve(Curve=plot_boundary, Distance=inward_offset, Corners=1)
move_to_floors = Move(Geometry=footprint_offset, Motion=Z)  # -> Geometry, Transform
facade = Loft(
    Curves=flatten(move_to_floors.Geometry),
    Options={Adjust=False, Closed=False, LoftEnds=0, LoftSimp=0, LoftType=0, Rebuild=10, Refit=0.01})
facade_preview = CustomPreview(Geometry=facade, Material=glass_material)
floor_plates = BoundarySurfaces(Edges=flatten(move_to_floors.Geometry))
floor = AddFloor(Boundary=graft(floor_plates), Type=item, Level=add_level, Structural=True, TrackingMode=2)
extrude = Extrude(Base=footprint_offset, Direction=amplitude)
footprint_area = Area(Geometry=footprint_offset)  # -> Area, Centroid
floor_preview = CustomPreview(Geometry=floor_plates, Material=concrete_swatch)
area_check = SmallerThan(FirstNumber=footprint_area.Area, SecondNumber=_60_plot_area)  # -> SmallerThan, OrEqualTo
len = Length(Curve=footprint_offset)
spacing_calc = Division(A=len, B=col_spacing)
expression = Expression(x=plot_area.Area, Expression="Round(x)")
item_3 = ListItem(List=add_level, Index=0, Wrap=True)
division = Division(A=footprint_area.Area, B=plot_area.Area)
column_base_points = DivideCurve(Curve=footprint_offset, Count=spacing_calc, Kinks=False)  # -> Points, Tangents, Parameters
materials = QueryMaterials(Name="Glass")
area = Area(Geometry=floor_plates)  # -> Area, Centroid
column = AddColumn(Location=column_base_points.Points, Base=item_3, Top=item_2, TrackingMode=2)
categories_2 = QueryCategories(Type=1, Name="Generic Models", IsVisibleUI=True, IsSubcategory=False)
multiplication = Multiplication(A=division, B=100)
ma = MassAddition(Input=area.Area)  # -> Result, PartialResults
larger = LargerThan(FirstNumber=multiplication, SecondNumber=60)  # -> LargerThan, OrEqualTo
expression_2 = Expression(x=ma.Result, Expression="Round(x)")
filter = StreamFilter(Gate=larger.LargerThan, Stream1="WARNING: FOOTPRINT EXCEEDS 60%!")
add_directshape_geometry = AddDirectShapeGeometry(Name="Facade", Category=categories_2, Geometry=extrude, Material=materials, TrackingMode=2)
concat_3 = Concatenate(FragmentA=concat_2, FragmentB=expression_2)
expression_3 = Expression(x=multiplication, Expression="Round(x*10)/10")
area_2 = Area(Geometry=extrude)  # -> Area, Centroid
concat_4 = Concatenate(FragmentA=concat_3, FragmentB=""" m2
Total Facade Area: 0""")
ma_2 = MassAddition(Input=area_2.Area)  # -> Result, PartialResults
expression_4 = Expression(x=ma_2.Result, Expression="Round(x)")
tag = TextTag3D(Location=plot_area.Centroid, Text=filter, Size=20, Colour=ColourSwatch(SwatchColor=RGB(255, 0, 0)), Justification=7)
column_top_points = Move(Geometry=column_base_points.Points, Motion=top_vector)  # -> Geometry, Transform
concat_5 = Concatenate(FragmentA=concat_4, FragmentB=expression_4)
concat_6 = Concatenate(FragmentA=concat_5, FragmentB=""" m2
Total Number of Columns: 0""")
column_lines = Line(StartPoint=column_base_points.Points, EndPoint=column_top_points.Geometry)
lng = ListLength(List=column_base_points.Points)
concat_7 = Concatenate(FragmentA=concat_6, FragmentB=lng)
concat_8 = Concatenate(FragmentA=concat_7, FragmentB="Plot Area: 0")
steel_swatch = ColourSwatch(SwatchColor=RGB(76, 76, 76))
column_preview = CustomPreview(Geometry=column_lines, Material=steel_swatch)
concat_9 = Concatenate(FragmentA=concat_8, FragmentB=expression)
concat_10 = Concatenate(FragmentA=concat_9, FragmentB=""" m2
Footprint Coverage: 0""")
concat_11 = Concatenate(FragmentA=concat_10, FragmentB=expression_3)
concat_12 = Concatenate(FragmentA=concat_11, FragmentB="% (Target < 60%)")
panel = Panel(concat_12)
